# Grasshopper definition 20210207_Level Ekleme.gh (Grasshopper 1.0.7)
# plug-ins: Rhino.Inside for Autodesk Revit

level_sayisi = Slider(10, range=0..10)
kat_yuksekligi = Slider(552, range=0..1000)
series = Series(Start=0, Step=kat_yuksekligi, Count=level_sayisi)
series_2 = Series(Start=Slider(1, range=0..1), Step=1, Count=level_sayisi)
concatenate = Concatenate(FragmentA="Kat ", FragmentB=series_2)
add_level = AddLevel(Elevation=series, Name=concatenate)
panel = Panel(concatenate)
