# Grasshopper definition random-distribution-on-topography.gh (Grasshopper 1.0.7)
# plug-ins: Rhino.Inside for Autodesk Revit, EleFront

built_in_categories = BuiltInCategories("autodesk.revit.category.local:topography-1.0.0", LayoutLevel=2, SearchPattern="?topo")
category_filter = CategoryFilter(Categories=built_in_categories, Inverted=False)
query_elements = QueryElements(Filter=category_filter, Limit=100)  # -> Elements, Count
value_list = ValueList({"Point": 0, "Curve": 1, "Arc": 2, "Circle": 3, "Ellipse": 4, "Line": 5, "Polyline": 6, "Surface": 7, "Brep": 8, "Mesh": 9, "Polysurface": 10, "Block": 11, "Text": 12, "TextDot": 13, "Dimension": 14, "LinearDimension": 15, "AngularDimension": 16, "Hatch": 17, "Leader": 18}, selected="Mesh")
element_geometry = ElementGeometry(Elements=query_elements.Elements)
panel = Panel(query_elements.Elements)
filter_by_type = FilterByType(Geometry=element_geometry, ObjectType=value_list)
query_types = QueryTypes(Kind=3, TypeName="6m diameter, 12m high")
populate_geometry = PopulateGeometry(Geometry=filter_by_type, Count=100, Seed=1)
add_component_location = AddComponentLocation(Location=populate_geometry, Type=query_types, TrackingMode=2)
